vi "Function.gvi"   [LabVIEW NXG 4.0.0]
panel controls:
  "selector": bool
  "Add/Sub": bool
  "Slider 1": f64
  "Slider 2": f64
panel indicators:
  "Output": f64
  "Gauge": f64
diagram:
  while {
    case ($selector) {
      frame False, Default {
        w1 = 5
      }
      frame True {
        Add($"Slider 1", $"Slider 2") -> w2
        Subtract(x=$"Slider 1", y=$"Slider 2") -> w3
        Select(s=$"Add/Sub", t=w2, f=w3) -> w1
      }
    }
    $Gauge <- w1
    $Output <- w1
    stop if FALSE
  }
