vi "Function_gvi.gvi"   [LabVIEW NXG 4.0.0]
panel indicators:
  "value": bool
  "Chart": i32
diagram:
  s1 = uninitialised  # shift register
  while (iteration -> i1) {
    Not(x=FALSE) -> w1
    Quotient And Remainder(x=i1, y=20) -> (x-y*floor(x/y)=w2)
    Is Equal To 0(x=w2) -> w3
    Select(s=w3, t=w1, f=FALSE) -> w4
    $value <- w4
    Wait(time to wait=50)
    $Chart <- w2
    next s1 = w4
    stop if FALSE
  }
